# Grasshopper definition building generator.gh (Grasshopper 1.0.8)

inset_bay_count_length = Slider(4, range=1..5)
baycounty = Slider(6, range=1..7)
column_width = Slider(1.6, range=1.6..6)
arch_width = Slider(2.66, range=2..5)
baycountx = Slider(1, range=1..4)
inset_bay_count_width = Slider(2, range=1..3)
wall_thickness = Slider(0.5, range=0.3..0.5)
footprint = ValueList({"rectangle": "Rectangle", "L-shape": "L", "C-shape": "C", "courtyard": "Courtyard"}, selected="rectangle")
column_height = Slider(1.8, range=1.8..3)
expression = Expression(x=arch_width, y=column_height, Expression="x/2+y+0.5")
expression_2 = Expression(x=baycounty, y=column_width, z=arch_width, u=wall_thickness, Expression="x * (y+z)+ 2*u")
expression_3 = Expression(x=baycountx, y=column_width, z=arch_width, u=wall_thickness, Expression="x * (y+z)+ 2*u")
expression_4 = Expression(x=inset_bay_count_length, y=column_width, z=arch_width, u=wall_thickness, Expression="x * (y+z)+ u/2")
expression_5 = Expression(x=inset_bay_count_width, y=column_width, z=arch_width, u=wall_thickness, Expression="x * (y+z)+ u/2")

storey = Slider(1, range=1..3)
rooftype = ValueList({"flat", "gable", "pointed"}, selected="flat")
floor1type = ValueList({"arcade", "colonnade", "solid"}, selected="arcade")
floor1subtractadd = CSharpScript(
    colWidth=column_width,
    archWidth=arch_width,
    wallThickness=wall_thickness,
    bayCountX=baycountx,
    bayCountY=baycounty,
    colHeight=column_height,
    floor1Type=floor1type,
    length=expression_2,
    width=expression_3)  # -> out, a; inputs colWidth: Double, archWidth: Double, wallThickness: Double, bayCountX: Int32, bayCountY: Int32, colHeight: Double, floor1Type: String
# ---------- floor1subtractadd: C# ----------
// Grasshopper Script Instance
#region Usings
using System;
using System.Linq;
using System.Collections;
using System.Collections.Generic;
using System.Drawing;

using Rhino;
using Rhino.Geometry;

using Grasshopper;
using Grasshopper.Kernel;
using Grasshopper.Kernel.Data;
using Grasshopper.Kernel.Types;
#endregion

public class Script_Instance : GH_ScriptInstance
{
    private void RunScript(
		double colWidth,
		double archWidth,
		double wallThickness,
		int bayCountX,
		int bayCountY,
		double colHeight,
		string floor1Type,
		object length,
		object width,
		ref object a)
    {
        // Collect output Breps
        var breps = new List<Brep>();
        double tol = RhinoDoc.ActiveDoc?.ModelAbsoluteTolerance ?? 1e-6;

        // Common dimension conversions
        double widthVal  = ToDouble(width);
        double lengthVal = ToDouble(length);

        if (floor1Type == "arcade")
        {
            // Arcade logic: unchanged
            double extrudeY = -lengthVal;
            double extrudeX =  widthVal;
            double step     = archWidth + colWidth;
            double offset   = wallThickness + colWidth * 0.5 + archWidth * 0.5;

            // X-direction arcade openings (extrude along Y)
            for (int i = 0; i < bayCountX; i++)
            {
                double cx = offset + i * step;
                var bl   = new Point3d(cx - archWidth/2.0, 0, 0);
                var br   = new Point3d(cx + archWidth/2.0, 0, 0);
                var tl   = new Point3d(cx - archWidth/2.0, 0, colHeight);
                var tr   = new Point3d(cx + archWidth/2.0, 0, colHeight);
                var apex = new Point3d(cx, 0, colHeight + archWidth/2.0);

                var curves = new List<Curve>
                {
                    new Arc(tl, apex, tr).ToNurbsCurve(),
                    new Line(br, tr).ToNurbsCurve(),
                    new Line(bl, br).ToNurbsCurve(),
                    new Line(tl, bl).ToNurbsCurve()
                };
                var joined = Curve.JoinCurves(curves, tol);
                if (joined != null && joined.Length > 0)
                {
                    var prof = joined[0];
                    var extr = Extrusion.Create(prof, extrudeY, true);
                    if (extr != null)
                        breps.Add(extr.ToBrep(true));
                }
            }

            // Y-direction arcade openings (extrude along X)
            for (int j = 0; j < bayCountY; j++)
            {
                double cy = offset + j * step;
                var bl   = new Point3d(0, cy - archWidth/2.0, 0);
                var br   = new Point3d(0, cy + archWidth/2.0, 0);
                var tl   = new Point3d(0, cy - archWidth/2.0, colHeight);
                var tr   = new Point3d(0, cy + archWidth/2.0, colHeight);
                var apex = new Point3d(0, cy, colHeight + archWidth/2.0);

                var curves = new List<Curve>
                {
                    new Arc(tl, apex, tr).ToNurbsCurve(),
                    new Line(br, tr).ToNurbsCurve(),
                    new Line(bl, br).ToNurbsCurve(),
                    new Line(tl, bl).ToNurbsCurve()
                };
                var joined = Curve.JoinCurves(curves, tol);
                if (joined != null && joined.Length > 0)
                {
                    var prof = joined[0];
                    var extr = Extrusion.Create(prof, extrudeX, true);
                    if (extr != null)
                        breps.Add(extr.ToBrep(true));
                }
            }
        }
        else if (floor1Type == "colonnade")
        {
            // Only update colonnade positions; arcade code remains as above
            double radius    = wallThickness * 0.5;
            double height    = colHeight + archWidth * 0.5 + 0.5;

            // Place columns along X: from (½wt,½wt,0) to (width-½wt,½wt,0)
            double xStart = wallThickness * 0.5;
            double xEnd   = widthVal - wallThickness * 0.5;
            double yPos   = wallThickness * 0.5;
            double segX   = (xEnd - xStart) / bayCountX;
            for (int i = 0; i <= bayCountX; i++)
            {
                double x = xStart + segX * i;
                var center = new Point3d(x, yPos, 0);
                AddTuscanColumn(breps, center, radius, height, tol);
            }

            // Place columns along Y: from (½wt,½wt,0) to (½wt,length-½wt,0)
            double yStart = wallThickness * 0.5;
            double yEnd   = lengthVal - wallThickness * 0.5;
            double xPos   = wallThickness * 0.5;
            double segY   = (yEnd - yStart) / bayCountY;
            for (int j = 0; j <= bayCountY; j++)
            {
                double y = yStart + segY * j;
                var center = new Point3d(xPos, y, 0);
                AddTuscanColumn(breps, center, radius, height, tol);
            }
        }
        else if (floor1Type == "solid")
        {
            // TODO: implement solid building logic
        }

        a = breps.ToArray();
    }

    private void AddTuscanColumn(List<Brep> breps, Point3d baseCenter, double radius, double height, double tol)
    {
        // Tuscan proportions: base 10%, shaft 80%, capital 10%
        double baseH  = height * 0.1;
        double capH   = height * 0.1;
        double shaftH = height - baseH - capH;
        double shaftR = radius * 0.8;
        double capR   = radius * 0.9;

        // Base
        var baseC = new Circle(new Plane(baseCenter, Vector3d.ZAxis), radius);
        breps.Add(new Cylinder(baseC, baseH).ToBrep(true, true));
        // Shaft
        var shaftC = new Circle(
            new Plane(baseCenter + Vector3d.ZAxis * baseH, Vector3d.ZAxis), shaftR);
        breps.Add(new Cylinder(shaftC, shaftH).ToBrep(true, true));
        // Capital
        var capC   = new Circle(
            new Plane(baseCenter + Vector3d.ZAxis * (baseH + shaftH), Vector3d.ZAxis), capR);
        breps.Add(new Cylinder(capC, capH).ToBrep(true, true));
    }

    private double ToDouble(object o)
    {
        if (o is double d) return d;
        if (o is int    i) return i;
        try { return Convert.ToDouble(o); } catch { return 0.0; }
    }
}
# ---------- end floor1subtractadd ----------
footprint_curve = CSharpScript(footprint=footprint, length=expression_2, width=expression_3, insetLength=expression_4, insetWidth=expression_5)  # -> out, a; inputs footprint: String, length: Double, width: Double, insetLength: Double, insetWidth: Double
# ---------- footprint_curve: C# ----------
// Grasshopper Script Instance
#region Usings
using System;
using System.Linq;
using System.Collections;
using System.Collections.Generic;
using System.Drawing;

using Rhino;
using Rhino.Geometry;

using Grasshopper;
using Grasshopper.Kernel;
using Grasshopper.Kernel.Data;
using Grasshopper.Kernel.Types;
#endregion

public class Script_Instance : GH_ScriptInstance
{
    #region Notes
    /* 
      Members:
        RhinoDoc RhinoDocument
        GH_Document GrasshopperDocument
        IGH_Component Component
        int Iteration

      Methods (Virtual & overridable):
        Print(string text)
        Print(string format, params object[] args)
        Reflect(object obj)
        Reflect(object obj, string method_name)
    */
    #endregion

private void RunScript(
		string footprint,
		double length,
		double width,
		double insetLength,
		double insetWidth,
		ref object a)
    {
        // Tolerance for boolean operations
        double tol = Rhino.RhinoDoc.ActiveDoc?.ModelAbsoluteTolerance ?? Rhino.RhinoMath.UnsetValue;

        // 1. Create the outer rectangle
        var outer = new Rectangle3d(Plane.WorldXY, width, length).ToNurbsCurve();

        // 2. Prepare result list for footprint curves
        List<Curve> result = new List<Curve>();

        // 3. Compute footprint based on type
        switch (footprint)
        {
            case "Rectangle":
                result.Add(outer);
                break;

            case "L":
                {
                    var notch = new Rectangle3d(Plane.WorldXY, insetWidth, insetLength).ToNurbsCurve();
                    notch.Translate(new Vector3d(width - insetWidth, length - insetLength, 0));
                    var diffs = Curve.CreateBooleanDifference(outer, notch, tol);
                    if (diffs != null) result.AddRange(diffs);
                }
                break;

            case "C":
                {
                    var notch = new Rectangle3d(Plane.WorldXY, insetWidth, insetLength).ToNurbsCurve();
                    notch.Translate(new Vector3d((width - insetWidth) / 2.0, length - insetLength, 0));
                    var diffs = Curve.CreateBooleanDifference(outer, notch, tol);
                    if (diffs != null)
                        result.AddRange(diffs);
                }
                break;

            case "Courtyard":
                {
                    var hole = new Rectangle3d(Plane.WorldXY, insetWidth, insetLength).ToNurbsCurve();
                    hole.Translate(new Vector3d((width - insetWidth) / 2.0, (length - insetLength) / 2.0, 0));
                    var diffs = Curve.CreateBooleanDifference(outer, hole, tol);
                    if (diffs != null)
                        result.AddRange(diffs);
                }
                break;

            default:
                result.Add(outer);
                break;
        }

        // 4. Output handling
        // Preserve both outer and hole for courtyard
        if (footprint == "Courtyard")
        {
            a = result.Count > 0 ? (object)result : null;
            return;
        }

        // For other types, if only one curve, output it
        if (result.Count == 1)
        {
            a = result[0];
            return;
        }

        // If multiple segments, try to join
        if (result.Count > 1)
        {
            var joined = Curve.JoinCurves(result, tol);
            if (joined != null && joined.Length > 0)
            {
                a = joined[0];
                return;
            }
        }

        // Fallback: null if nothing
        a = null;
    }
}
# ---------- end footprint_curve ----------
floor1envelope = CSharpScript(footprintCurve=footprint_curve.a, wallThickness=wall_thickness, floor1Height=expression, floor1Type=floor1type)  # -> out, a; inputs wallThickness: Double, floor1Height: Double, floor1Type: String
# ---------- floor1envelope: C# ----------
// Grasshopper Script Instance
#region Usings
using System;
using System.Linq;
using System.Collections;
using System.Collections.Generic;
using System.Drawing;

using Rhino;
using Rhino.Geometry;

using Grasshopper;
using Grasshopper.Kernel;
using Grasshopper.Kernel.Data;
using Grasshopper.Kernel.Types;
#endregion

public class Script_Instance : GH_ScriptInstance
{
    #region Notes
    /* 
      Members:
        RhinoDoc RhinoDocument
        GH_Document GrasshopperDocument
        IGH_Component Component
        int Iteration

      Methods (Virtual & overridable):
        Print(string text)
        Print(string format, params object[] args)
        Reflect(object obj)
        Reflect(object obj, string method_name)
    */
    #endregion

    private void RunScript(
		object footprintCurve,
		double wallThickness,
		double floor1Height,
		string floor1Type,
		ref object a)
    {
        // 1. Cast input to a Rhino curve
        var outer = footprintCurve as Rhino.Geometry.Curve;
        if (outer == null)
        {
            a = null;
            return;
        }

        // 2. Only do work if floor1Type is "arcade"
        if (!string.Equals(floor1Type, "arcade", StringComparison.OrdinalIgnoreCase))
        {
            a = null;
            return;
        }

        double tol = RhinoDocument.ModelAbsoluteTolerance;

        // 3. If the input is a polyline that isn't closed, close it
        if (!outer.IsClosed)
        {
            Rhino.Geometry.Polyline pl;
            if (outer.TryGetPolyline(out pl))
            {
                if (!pl.IsClosed) pl.Add(pl[0]);
                outer = new Rhino.Geometry.PolylineCurve(pl);
            }
        }

        // 4. Offset inward by wallThickness
        var inners = outer.Offset(
            Rhino.Geometry.Plane.WorldXY,
            -wallThickness,
            tol,
            Rhino.Geometry.CurveOffsetCornerStyle.Sharp);
        if (inners == null || inners.Length == 0)
        {
            a = null;
            return;
        }
        var inner = inners[0];

        // 5. Ensure the inner curve is closed too
        if (!inner.IsClosed)
        {
            Rhino.Geometry.Polyline pl2;
            if (inner.TryGetPolyline(out pl2))
            {
                if (!pl2.IsClosed) pl2.Add(pl2[0]);
                inner = new Rhino.Geometry.PolylineCurve(pl2);
            }
        }

        // 6. Make a planar Brep ring between outer & inner
        var planar = Rhino.Geometry.Brep.CreatePlanarBreps(
            new Rhino.Geometry.Curve[] { outer, inner },
            tol);
        if (planar == null || planar.Length == 0)
        {
            a = null;
            return;
        }
        var region = planar[0];

        // 7. Build a spine line straight up from the region's centroid
        var bbox = region.GetBoundingBox(true);
        var bottom = bbox.Center;
        var top    = bbox.Center;
        top.Z += floor1Height;
        var spine  = new Rhino.Geometry.LineCurve(bottom, top);

        // 8. Extrude that single planar face along the spine (caps both ends)
        var face      = region.Faces[0];
        var extruded  = face.CreateExtrusion(spine, true);

        a = extruded;  
    }
}
# ---------- end floor1envelope ----------
c_script = CSharpScript(floor1Envelope=floor1envelope.a, subtractAdd=floor1subtractadd.a, floor1Type=floor1type)  # -> out, a; inputs floor1Envelope: Brep, subtractAdd: Brep, floor1Type: String
# ---------- c_script: C# ----------
// Grasshopper Script Instance
#region Usings
using System;
using System.Linq;
using System.Collections;
using System.Collections.Generic;
using System.Drawing;

using Rhino;
using Rhino.Geometry;

using Grasshopper;
using Grasshopper.Kernel;
using Grasshopper.Kernel.Data;
using Grasshopper.Kernel.Types;
#endregion

public class Script_Instance : GH_ScriptInstance
{
    #region Notes
    /* 
      Members:
        RhinoDoc RhinoDocument
        GH_Document GrasshopperDocument
        IGH_Component Component
        int Iteration

      Methods (Virtual & overridable):
        Print(string text)
        Print(string format, params object[] args)
        Reflect(object obj)
        Reflect(object obj, string method_name)
    */
    #endregion

    private void RunScript(
		Brep floor1Envelope,
		Brep subtractAdd,
		string floor1Type,
		ref object a)
    {
        // validate inputs
        if (floor1Envelope == null || subtractAdd == null)
        {
            a = null;
            return;
        }

        double tol = RhinoDocument.ModelAbsoluteTolerance;
        Brep result = null;

        // arcade: envelope MINUS subtractAdd → produce one joined solid
        if (string.Equals(floor1Type, "arcade", StringComparison.OrdinalIgnoreCase))
        {
            var diffs = Brep.CreateBooleanDifference(
                new[] { floor1Envelope },
                new[] { subtractAdd },
                tol
            );

            if (diffs != null && diffs.Length > 0)
            {
                // attempt to join all difference fragments into a single solid
                var joined = Brep.JoinBreps(diffs, tol);
                if (joined != null && joined.Length > 0)
                    result = joined[0];
                else
                    result = diffs[0];  // fallback to first fragment
            }
            else
            {
                // Fallback: reverse order if nothing came back
                var diffs2 = Brep.CreateBooleanDifference(
                    new[] { subtractAdd },
                    new[] { floor1Envelope },
                    tol
                );
                if (diffs2 != null && diffs2.Length > 0)
                {
                    var joined2 = Brep.JoinBreps(diffs2, tol);
                    result = (joined2 != null && joined2.Length > 0)
                             ? joined2[0]
                             : diffs2[0];
                }
                else
                {
                    // if both fail, just return the original envelope
                    result = floor1Envelope;
                }
            }
        }
        // colonnade: just output the opening geometry
        else if (string.Equals(floor1Type, "colonnade", StringComparison.OrdinalIgnoreCase))
        {
            result = subtractAdd;
        }

        a = result;
    }
}
# ---------- end c_script ----------
sdiff = SolidDifference(BrepsA=floor1envelope.a, BrepsB=floor1subtractadd.a)
floor_thickness = Slider(0.3, range=0.3..1)
Z = UnitZ(Factor=expression)
floor_offset = Slider(0.25, range=0.1..0.25)
move = Move(Geometry=footprint_curve.a, Motion=Z)  # -> Geometry, Transform
Z_2 = UnitZ(Factor=floor_thickness)
offset = OffsetCurve(Curve=move.Geometry, Distance=floor_offset, Corners=1)
boundary = BoundarySurfaces(Edges=offset)
extr = Extrude(Base=boundary, Direction=Z_2)
